% Simulink data dictionary ReactionWheelPendulum.sldd

Bb = 0
MassWheel_kg = 0.092779
g_mps_2 = 9.81
MassBody_kg = 0.49436
BodyCGDist_mm = 73.103937
WheelCGDist_mm = 68.760176
IWheelCG_kgm_2 = 0.00010714633
IBodyPivot_kgm_2 = 0.004054322
IWheelPivot_kgm_2 = 0.00054580359
TorqueLimit_Nm = 0.2
GearRatio_na = 3